# Grasshopper definition 3DPackageCreator.gh (Grasshopper 1.0.7)
# plug-ins: Human UI, ModelecComponents

# ---- group: Pad Name / File Name
textbox = CreateTextBox(Label="File Name:", UpdateButton=Toggle(False), showLabel=True)
adjustpos = AdjustElementPositioning(
    ElementsToAdjust=textbox,
    Margin="450,-130,0,5",
    AbsolutePositioning=False,
    Width="130",
    Height="30",
    HorizontalAlignment="0")

# ---- group: Pad Name
textbox_2 = CreateTextBox(Label="Pad Name:", UpdateButton=Toggle(False), showLabel=True)
adjustpos_2 = AdjustElementPositioning(
    ElementsToAdjust=textbox_2,
    Margin="5,0,0,5",
    AbsolutePositioning=False,
    Width="250",
    Height="30",
    HorizontalAlignment="0")

# ----
values = ValueListener(Elements=textbox_2, SomeProperty=True)  # -> Values, Indices
values_2 = ValueListener(Elements=textbox, SomeProperty=True)  # -> Values, Indices

# ---- group: Save
colour = ColourPicker(PickedColour=RGB(132, 173, 214))
colour_2 = ColourPicker(PickedColour=RGB(255, 255, 214))
button = CreateButton(ButtonName="Save model", ButtonStyle=0)
adjustpos_3 = AdjustElementPositioning(
    ElementsToAdjust=button,
    Margin="460,-45,0,0",
    AbsolutePositioning=False,
    Width="120",
    Height="40",
    HorizontalAlignment="0")
adjustelem = AdjustElementAppearance(ElementsToAdjust=button, Foreground=colour_2)
adjustelem_2 = AdjustElementAppearance(ElementsToAdjust=button, Background=colour, FontSize=Slider(13, range=0..20))
values_3 = ValueListener(Elements=button, SomeProperty=True)  # -> Values, Indices

# ---- group: Add pad position
button_2 = CreateButton(ButtonName="Add pad position", ButtonStyle=0)
adjustpos_4 = AdjustElementPositioning(
    ElementsToAdjust=button_2,
    Margin="5,0,0,5",
    AbsolutePositioning=False,
    Width="150",
    Height="40",
    HorizontalAlignment="0")
values_4 = ValueListener(Elements=button_2, SomeProperty=True)  # -> Values, Indices
c_script = CSharpScript()  # -> out, A
# ---------- c_script: C# ----------
    GH_Document gh_d = owner.OnPingDocument();
    
    if(gh_d.IsFilePathDefined)
    {
      A = gh_d.FilePath;
    }
# ---------- end c_script ----------

# ----
addpad = AddPadComponent(SetPosBtnClicked=values_4.Values, PadName=values.Values)
up = UpdateComponent(PadListUpdate=addpad)
panel = Panel(up)
listbox = CreateListBox(ListItems=panel, SelectedIndex="-1", Height="30")
adjustpos_5 = AdjustElementPositioning(
    ElementsToAdjust=listbox,
    Margin="270,-85,0,5",
    AbsolutePositioning=False,
    Width="170",
    Height="80",
    HorizontalAlignment="0")
border = CreateBorder(UIElement=listbox, BorderThickness="1", BorderColor=RGB(0, 0, 0), CornerRadius=0)
adjustpos_6 = AdjustElementPositioning(
    ElementsToAdjust=border,
    Margin="270,-85,0,5",
    AbsolutePositioning=False,
    Width="170",
    Height="80",
    HorizontalAlignment="0")
values_5 = ValueListener(Elements=listbox, SomeProperty=True)  # -> Values, Indices
sel3dpp = Select3DPrintedPartFromListComponent(PartName=values_5.Values)
panel_2 = Panel(values_5.Values)
save = SaveComponent(SetPosBtnClicked=values_3.Values, PadName=values_2.Values)
merge = Merge(Data1=textbox_2, Data2=button_2, Data3=listbox, Data4=border, Data5=textbox, Data6=button)

# ---- group: Window
launchwin = LaunchWindow(
    Show=Toggle(True),
    Name="Modelec 3D Model Package Creator",
    Width="600",
    Height="130",
    ChildStatus=0,
    EnableHorizScroll=False)
addelems = AddElements(Window=launchwin, Elements=flatten(merge), DoVLChecking=True)  # -> AddedElements, ElementNames
