# Grasshopper definition ModelecMainInterface.gh (Grasshopper 1.0.7)
# plug-ins: Human UI, ModelecComponents

# ---- group: Hide All Traces
checkbox = CreateCheckbox(Label="Hide all the traces", StartingValue=False)
adjustpos = AdjustElementPositioning(
    ElementsToAdjust=checkbox,
    Margin="7,-40,0,5",
    AbsolutePositioning=False,
    Width="200",
    Height="40",
    HorizontalAlignment="0")
values = ValueListener(Elements=checkbox, SomeProperty=True)  # -> Values, Indices
hidetraces = HideTracesComponent(HideAllTracesBtnClicked=values.Values)

# ---- group: Auto-Route
button = CreateButton(ButtonName="Auto-Route", ButtonStyle=0)
adjustpos_2 = AdjustElementPositioning(
    ElementsToAdjust=button,
    Margin="145,-45,0,5",
    AbsolutePositioning=False,
    Width="70",
    Height="30",
    HorizontalAlignment="0")
values_2 = ValueListener(Elements=button, SomeProperty=True)  # -> Values, Indices
aurou = AutoRouteCommand(AutoRouteBtnClicked=values_2.Values)

# ---- group: Trace-from-point
button_2 = CreateButton(ButtonName="Manual Route", ButtonStyle=0)
adjustpos_3 = AdjustElementPositioning(
    ElementsToAdjust=button_2,
    Margin="225,-45,0,5",
    AbsolutePositioning=False,
    Width="80",
    Height="30",
    HorizontalAlignment="0")

# ---- group: Delete trace
button_3 = CreateButton(ButtonName="Delete Trace", ButtonStyle=0)
adjustpos_4 = AdjustElementPositioning(
    ElementsToAdjust=button_3,
    Margin="180,65,0,5",
    AbsolutePositioning=False,
    Width="125",
    Height="30",
    HorizontalAlignment="0")
values_3 = ValueListener(Elements=button_3, SomeProperty=True)  # -> Values, Indices

# ----
values_4 = ValueListener(Elements=button_2, SomeProperty=True)  # -> Values, Indices
manrou = ManualRouteComponent(ManualRouteBtnClicked=values_4.Values)

# ---- group: Show Jumping WIres
checkbox_2 = CreateCheckbox(Label="Connection preview", StartingValue=False)
adjustpos_5 = AdjustElementPositioning(
    ElementsToAdjust=checkbox_2,
    Margin="7,-15,0,5",
    AbsolutePositioning=False,
    Width="200",
    Height="40",
    HorizontalAlignment="0")
values_5 = ValueListener(Elements=checkbox_2, SomeProperty=True)  # -> Values, Indices

# ----
deltrace = DeleteOneTraceComponent(DeleteTraceBtnClicked=values_3.Values)
updatetracelist = UpdateTraceListComponent(AddAutoListUpdated=aurou, AddManualListUpdated=manrou, DelListUpdated=deltrace)
conpre = ConPreviewComponent(ConnectionPreviewBtnClicked=values_5.Values)

# ---- group: Trace List
panel = Panel(updatetracelist)
listbox = CreateListBox(ListItems=panel, SelectedIndex="-1", Height="30")
setlist = SetListContents(ListToModify=listbox)
adjustpos_6 = AdjustElementPositioning(
    ElementsToAdjust=listbox,
    Margin="5,-230,0,5",
    AbsolutePositioning=False,
    Width="300",
    Height="60",
    HorizontalAlignment="0")

# ---- group: Validating Parts
button_4 = CreateButton(ButtonName="Adapt to new shape", ButtonStyle=0)
adjustpos_7 = AdjustElementPositioning(
    ElementsToAdjust=button_4,
    Margin="5,-5,0,5",
    AbsolutePositioning=False,
    Width="300",
    Height="35",
    HorizontalAlignment="0")
values_6 = ValueListener(Elements=button_4, SomeProperty=True)  # -> Values, Indices
validateparts = ValidatePartsComponent(ValidatePartsBtnClicked=values_6.Values)

# ---- group: Part Flip
checkbox_3 = CreateCheckbox(Label="Flip", StartingValue=False)
adjustpos_8 = AdjustElementPositioning(
    ElementsToAdjust=checkbox_3,
    Margin="5,-10,0,0",
    AbsolutePositioning=False,
    Width="145",
    Height="40",
    HorizontalAlignment="0")
values_7 = ValueListener(Elements=checkbox_3, SomeProperty=True)  # -> Values, Indices
pflip = PartFlipComponent(FlipPartBtnClicked=values_7.Values)

# ---- group: Load Custom Component Model
button_5 = CreateButton(ButtonName="Load Custom Part", ButtonStyle=0)
adjustpos_9 = AdjustElementPositioning(
    ElementsToAdjust=button_5,
    Margin="205,-265,0,5",
    AbsolutePositioning=False,
    Width="100",
    Height="30",
    HorizontalAlignment="0")
values_8 = ValueListener(Elements=button_5, SomeProperty=True)  # -> Values, Indices

# ----
textbox = CreateTextBox(Label="Protrusion (%):", UpdateButton=True, showLabel=True)
border = CreateBorder(UIElement=listbox, BorderThickness="1", BorderColor=RGB(0, 0, 0), CornerRadius=0)
adjustpos_10 = AdjustElementPositioning(
    ElementsToAdjust=border,
    Margin="5,-230,0,5",
    AbsolutePositioning=False,
    Width="300",
    Height="60",
    HorizontalAlignment="0")

# ---- group: Move Part
c_script = CSharpScript()  # -> out, A
# ---------- c_script: C# usings ----------
using System.IO;
using System.Linq;
using System.Data;
using System.Drawing;
using System.Reflection;
using System.Windows.Forms;
using System.Xml;
using System.Xml.Linq;
using System.Runtime.InteropServices;

using Rhino.DocObjects;
using Rhino.Collections;
using GH_IO;
using GH_IO.Serialization;
# ---------- c_script: C# ----------
    GH_Document gh_d = owner.OnPingDocument();

    if(gh_d.IsFilePathDefined){
      Print("A path is defined.");
      A = gh_d.FilePath.Substring(0, gh_d.FilePath.LastIndexOf('\\')) + @"\ModelecComponents\ModelecComponents\bin\Sources\move.png";
    }
    else{
      Print("No path defined.");
    }
# ---------- end c_script ----------
button_6 = CreateButton(ImagePath=c_script.A, ButtonStyle=0)
adjustpos_11 = AdjustElementPositioning(
    ElementsToAdjust=button_6,
    Margin="240,-105,0,5",
    AbsolutePositioning=False,
    Width="30",
    Height="30",
    HorizontalAlignment="0")
adjustelem = AdjustElementAppearance(ElementsToAdjust=button_6, FontSize=Slider(13, range=0..20))

# ---- group: Exposure Level
adjustpos_12 = AdjustElementPositioning(ElementsToAdjust=textbox, Margin="0,5,0,5", AbsolutePositioning=False, Width="190", HorizontalAlignment="0")
values_9 = ValueListener(Elements=textbox, SomeProperty=True)  # -> Values, Indices
pexp = PartExpComponent(PartExposure=values_9.Values)

# ----
values_10 = ValueListener(Elements=listbox, SomeProperty=True)  # -> Values, Indices

# ---- group: Part Visibility
checkbox_4 = CreateCheckbox(Label="Hide", StartingValue=False)
adjustpos_13 = AdjustElementPositioning(
    ElementsToAdjust=checkbox_4,
    Margin="60,-40,0,5",
    AbsolutePositioning=False,
    Width="145",
    Height="40",
    HorizontalAlignment="0")
values_11 = ValueListener(Elements=checkbox_4, SomeProperty=True)  # -> Values, Indices
phide = PartHideComponent(HidePartBtnClicked=values_11.Values)

# ----
seltracefromlist = SelectTraceFromListComponent(TraceDesp=values_10.Values)
textbox_2 = CreateTextBox(Label="Rotation angle (°):", UpdateButton=True, showLabel=True)

# ---- group: Rotate Part
adjustpos_14 = AdjustElementPositioning(ElementsToAdjust=textbox_2, Margin="0,-5,0,5", AbsolutePositioning=False, Width="190", HorizontalAlignment="0")
values_12 = ValueListener(Elements=textbox_2, SomeProperty=True)  # -> Values, Indices
prot = PartRotateComponent(RotatePartAngle=values_12.Values)

# ---- group: Nudge Part
c_script_2 = CSharpScript()  # -> out, A
# ---------- c_script_2: C# ----------
    GH_Document gh_d = owner.OnPingDocument();

    if(gh_d.IsFilePathDefined){
      Print("A path is defined.");
      A = gh_d.FilePath.Substring(0, gh_d.FilePath.LastIndexOf('\\')) + @"\ModelecComponents\ModelecComponents\bin\Sources\nudge-left.png";
    }
    else{
      Print("No path defined.");
    }
# ---------- end c_script_2 ----------
c_script_3 = CSharpScript()  # -> out, A
# ---------- c_script_3: C# ----------
    GH_Document gh_d = owner.OnPingDocument();

    if(gh_d.IsFilePathDefined){
      Print("A path is defined.");
      A = gh_d.FilePath.Substring(0, gh_d.FilePath.LastIndexOf('\\')) + @"\ModelecComponents\ModelecComponents\bin\Sources\nudge-up.png";
    }
    else{
      Print("No path defined.");
    }
# ---------- end c_script_3 ----------
c_script_4 = CSharpScript()  # -> out, A
# ---------- c_script_4: C# ----------
    GH_Document gh_d = owner.OnPingDocument();

    if(gh_d.IsFilePathDefined){
      Print("A path is defined.");
      A = gh_d.FilePath.Substring(0, gh_d.FilePath.LastIndexOf('\\')) + @"\ModelecComponents\ModelecComponents\bin\Sources\nudge-right.png";
    }
    else{
      Print("No path defined.");
    }
# ---------- end c_script_4 ----------
c_script_5 = CSharpScript()  # -> out, A
# ---------- c_script_5: C# ----------
    GH_Document gh_d = owner.OnPingDocument();

    if(gh_d.IsFilePathDefined){
      Print("A path is defined.");
      A = gh_d.FilePath.Substring(0, gh_d.FilePath.LastIndexOf('\\')) + @"\ModelecComponents\ModelecComponents\bin\Sources\nudge-down.png";
    }
    else{
      Print("No path defined.");
    }
# ---------- end c_script_5 ----------
button_7 = CreateButton(ImagePath=c_script_2.A, ButtonStyle=0)
button_8 = CreateButton(ImagePath=c_script_3.A, ButtonStyle=0)
button_9 = CreateButton(ImagePath=c_script_4.A, ButtonStyle=0)
button_10 = CreateButton(ImagePath=c_script_5.A, ButtonStyle=0)
adjustpos_15 = AdjustElementPositioning(
    ElementsToAdjust=button_7,
    Margin="205,-105,0,5",
    AbsolutePositioning=False,
    Width="30",
    Height="30",
    HorizontalAlignment="0")
adjustpos_16 = AdjustElementPositioning(
    ElementsToAdjust=button_8,
    Margin="240,-145,0,5",
    AbsolutePositioning=False,
    Width="30",
    Height="30",
    HorizontalAlignment="0")
adjustpos_17 = AdjustElementPositioning(
    ElementsToAdjust=button_9,
    Margin="275,-75,0,5",
    AbsolutePositioning=False,
    Width="30",
    Height="30",
    HorizontalAlignment="0")
adjustpos_18 = AdjustElementPositioning(
    ElementsToAdjust=button_10,
    Margin="240,-20,0,5",
    AbsolutePositioning=False,
    Width="30",
    Height="30",
    HorizontalAlignment="0")

# ---- group: Part 3D Printablility
checkbox_5 = CreateCheckbox(Label="3D printable", StartingValue=False)
adjustpos_19 = AdjustElementPositioning(
    ElementsToAdjust=checkbox_5,
    Margin="120,-45,0,5",
    AbsolutePositioning=False,
    Width="145",
    Height="40",
    HorizontalAlignment="0")
values_13 = ValueListener(Elements=checkbox_5, SomeProperty=True)  # -> Values, Indices

# ---- group: Printer Profile Load
button_11 = CreateButton(ButtonName="Load Profile", ButtonStyle=0)
adjustpos_20 = AdjustElementPositioning(ElementsToAdjust=button_11, Margin="5,-10,0,5", AbsolutePositioning=False, Width="110", HorizontalAlignment="0")
values_14 = ValueListener(Elements=button_11, SomeProperty=True)  # -> Values, Indices
ppp = PrintProfileParserComponent(LoadPrinterProfile=values_14.Values)
panel_2 = Panel(ppp)
label = CreateLabel(LabelText="Load a JSON file...", LabelSize=12, Justification=0)
adjustpos_21 = AdjustElementPositioning(ElementsToAdjust=label, Margin="185,-35,0,5", AbsolutePositioning=False, Width="230", HorizontalAlignment="0")
setlabel = SetLabelContents(LabelToModify=label, NewLabelContents=ppp)

# ----
values_15 = ValueListener(Elements=button_9, SomeProperty=True)  # -> Values, Indices
values_16 = ValueListener(Elements=button_8, SomeProperty=True)  # -> Values, Indices
values_17 = ValueListener(Elements=button_10, SomeProperty=True)  # -> Values, Indices
values_18 = ValueListener(Elements=button_7, SomeProperty=True)  # -> Values, Indices

# ---- group: Circuit Load
button_12 = CreateButton(ButtonName="Load Circuit", ButtonStyle=0)
adjustpos_22 = AdjustElementPositioning(ElementsToAdjust=button_12, Margin="5,0,0,5", AbsolutePositioning=False, Width="80", HorizontalAlignment="0")
values_19 = ValueListener(Elements=button_12, SomeProperty=True)  # -> Values, Indices
c_script_6 = CSharpScript()  # -> out, A
# ---------- c_script_6: C# ----------
    GH_Document gh_d = owner.OnPingDocument();
    
    if(gh_d.IsFilePathDefined)
    {
      A = gh_d.FilePath;
    }
# ---------- end c_script_6 ----------
lc = LoadCircuit(LoadCircuitStart=values_19.Values, CurrentDirectory=c_script_6.A)  # -> ClickNum, CircuitInfo, SchematicPath, SharedData, ImageScalar, ImageWidth, ImageHeight, IsActive
panel_3 = Panel(lc.ClickNum)
label_2 = CreateLabel(LabelText="Load a circuit...", LabelSize=12, Justification=0)
adjustpos_23 = AdjustElementPositioning(ElementsToAdjust=label_2, Margin="90,-35,0,5", AbsolutePositioning=False, Width="230", HorizontalAlignment="0")
setlabel_2 = SetLabelContents(LabelToModify=label_2, NewLabelContents=lc.CircuitInfo)

# ----
part3dprintable = SetPart3DPrintableComponent(SetPartPrintableBtnClicked=values_13.Values)

# ---- group: Part Display
panel_4 = Panel(""" 
  
 
 
 """)
sb = StackedButtonsComponent(IsActive=lc.IsActive)
pulldown = CreatePulldownMenu(Label="Part list:", ListItems=panel_4, showLabel=True)
adjustpos_24 = AdjustElementPositioning(
    ElementsToAdjust=pulldown,
    Margin="0,-15,0,5",
    AbsolutePositioning=False,
    Width="180",
    Height="35",
    HorizontalAlignment="0")
setlist_2 = SetListContents(ListToModify=pulldown, NewListContents=sb)
values_20 = ValueListener(Elements=pulldown, SomeProperty=True)  # -> Values, Indices

# ---- group: Splits / Split 2
panel_5 = Panel("----------------------- Trace Control -------------------------------------------------------")
label_3 = CreateLabel(LabelText=panel_5, LabelSize=12, Justification=0)
adjustpos_25 = AdjustElementPositioning(
    ElementsToAdjust=label_3,
    Margin="0,-5,0,0",
    AbsolutePositioning=False,
    Width="310",
    Height="40",
    HorizontalAlignment="0")

# ---- group: Splits / Split 3
panel_6 = Panel("----------------------- Printer Profile -------------------------------------------------------")
label_4 = CreateLabel(LabelText=panel_6, LabelSize=12, Justification=0)
panel_7 = Panel("310")
adjustpos_26 = AdjustElementPositioning(
    ElementsToAdjust=label_4,
    Margin="0,-10,0,0",
    AbsolutePositioning=False,
    Width=panel_7,
    Height="40",
    HorizontalAlignment="0")

# ---- group: Splits / Split4
panel_8 = Panel("----------------- 3D-Printable Part Control -------------------------------------------------------")
label_5 = CreateLabel(LabelText=panel_8, LabelSize=12, Justification=0)
adjustpos_27 = AdjustElementPositioning(
    ElementsToAdjust=label_5,
    Margin="0,-5,0,0",
    AbsolutePositioning=False,
    Width=panel_7,
    Height="40",
    HorizontalAlignment="0")

# ---- group: Splits / Split 1
panel_9 = Panel("----------------- Electronic Part Control ---------------------")
label_6 = CreateLabel(LabelText=panel_9, LabelSize=12, Justification=0)
adjustpos_28 = AdjustElementPositioning(ElementsToAdjust=label_6, Margin="0,0,0,0", AbsolutePositioning=False, Width="310", Height="40", HorizontalAlignment="0")

# ----
c_script_7 = CSharpScript()  # -> out, A; same code as c_script_6

# ---- group: 3DP List
panel_10 = Panel("""Connection Node
Capacitive Touch Area
Resistor""")
pulldown_2 = CreatePulldownMenu(Label="Part list:", ListItems=panel_10, showLabel=True)
adjustpos_29 = AdjustElementPositioning(
    ElementsToAdjust=pulldown_2,
    Margin="0,-15,0,5",
    AbsolutePositioning=False,
    Width="240",
    Height="35",
    HorizontalAlignment="0")
values_21 = ValueListener(Elements=pulldown_2, SomeProperty=True)  # -> Values, Indices

# ----
pp = PartParser(SelectedPart=values_20.Values, CurrentDirectory=c_script_7.A)  # -> Part3D, Dataset
loadcuscomp = LoadCustomComponentModelComponent(LoadCustomModel=values_8.Values, Part3D=pp.Part3D)
ntop = NudgeTopComponent(SetPosBtnClicked=values_16.Values, Part3D=pp.Part3D)
nright = NudgeRightComponent(SetPosBtnClicked=values_15.Values, Part3D=pp.Part3D)
nbottom = NudgeBottomComponent(SetPosBtnClicked=values_17.Values, Part3D=pp.Part3D)
nleft = NudgeLeftComponent(SetPosBtnClicked=values_18.Values, Part3D=pp.Part3D)

# ---- group: Part Spotlight Set
ps = ParseSpotlightComponent(Part3D=pp.Part3D, SchematicWidth=lc.ImageWidth, SchematicHeight=lc.ImageHeight)  # -> Visibility, Margins
c_script_8 = CSharpScript()  # -> out, A
# ---------- c_script_8: C# ----------
    GH_Document gh_d = owner.OnPingDocument();

    if(gh_d.IsFilePathDefined){
      Print("A path is defined.");
      A = gh_d.FilePath.Substring(0, gh_d.FilePath.LastIndexOf('\\')) + @"\ModelecComponents\ModelecComponents\bin\Sources\spotlight.png";
    }
    else{
      Print("No path defined.");
    }
# ---------- end c_script_8 ----------
c_script_9 = CSharpScript(x=ps.Visibility)  # -> out, A
# ---------- c_script_9: C# ----------
    if(x == null){
      A = false;
    }
    else{
      A = x; 
    }
# ---------- end c_script_9 ----------
image = CreateImage(ImageSource=c_script_8.A, ImageWidth="30", ImageHeight="30")
adjustpos_30 = AdjustElementPositioning(ElementsToAdjust=image, Margin=ps.Margins, AbsolutePositioning=False, HorizontalAlignment="0")
hideshow = HideShowElement(ElementToHideShow=image, Show=c_script_9.A, Collapse=True, Disable=False)

# ---- group: Save
colour = ColourPicker(PickedColour=RGB(132, 173, 214))
button_13 = CreateButton(ButtonName="Save to print", ButtonStyle=0)
adjustpos_31 = AdjustElementPositioning(
    ElementsToAdjust=button_13,
    Margin="5,0,0,0",
    AbsolutePositioning=False,
    Width="300",
    Height="40",
    HorizontalAlignment="0")
adjustelem_2 = AdjustElementAppearance(ElementsToAdjust=button_13, Background=colour, FontSize=Slider(13, range=0..20))

# ----
values_22 = ValueListener(Elements=button_6, SomeProperty=True)  # -> Values, Indices

# ---- group: Schematic Image
c_script_10 = CSharpScript()  # -> out, A
# ---------- c_script_10: C# ----------
    GH_Document gh_d = owner.OnPingDocument();

    if(gh_d.IsFilePathDefined){
      Print("A path is defined.");
      A = gh_d.FilePath.Substring(0, gh_d.FilePath.LastIndexOf('\\')) + @"\ModelecComponents\ModelecComponents\bin\Sources\schematic_placeholder.png";
    }
    else{
      Print("No path defined.");
    }
# ---------- end c_script_10 ----------
image_2 = CreateImage(ImageSource=c_script_10.A, ImageWidth=lc.ImageWidth, ImageHeight=lc.ImageHeight)
setimg = SetImage(ImageToModify=image_2, NewImagePath=lc.SchematicPath)
adjustpos_32 = AdjustElementPositioning(ElementsToAdjust=image_2, Margin="5,5,0,5", AbsolutePositioning=False, Width="300", HorizontalAlignment="0")

# ----
panel_11 = Panel(values_21.Values)
spp = SetPartPosComponent(SetPosBtnClicked=values_22.Values, Part3D=pp.Part3D)
button_14 = CreateButton(ButtonName="Manual Route", ButtonStyle=0)
adjustpos_33 = AdjustElementPositioning(
    ElementsToAdjust=button_14,
    Margin="115,-45,0,5",
    AbsolutePositioning=False,
    Width="100",
    Height="40",
    HorizontalAlignment="0")
adjustelem_3 = AdjustElementAppearance(ElementsToAdjust=button_14, FontSize=Slider(13, range=0..20))
colour_2 = ColourPicker(PickedColour=RGB(255, 255, 214))
button_15 = CreateButton(ButtonName="Delete", ButtonStyle=0)
adjustpos_34 = AdjustElementPositioning(
    ElementsToAdjust=button_15,
    Margin="225,-45,0,5",
    AbsolutePositioning=False,
    Width="80",
    Height="40",
    HorizontalAlignment="0")

# ---- group: 3DP Add
button_16 = CreateButton(ButtonName="Add", ButtonStyle=0)
adjustpos_35 = AdjustElementPositioning(
    ElementsToAdjust=button_16,
    Margin="245,-40,0,5",
    AbsolutePositioning=False,
    Width="60",
    Height="30",
    HorizontalAlignment="0")

# ----
adjustelem_4 = AdjustElementAppearance(ElementsToAdjust=button_15, FontSize=Slider(13, range=0..20))
adjustelem_5 = AdjustElementAppearance(ElementsToAdjust=button_13, Foreground=colour_2)
values_23 = ValueListener(Elements=button_15, SomeProperty=True)  # -> Values, Indices
values_24 = ValueListener(Elements=button_14, SomeProperty=True)  # -> Values, Indices
values_25 = ValueListener(Elements=button_13, SomeProperty=True)  # -> Values, Indices
values_26 = ValueListener(Elements=button_16, SomeProperty=True)  # -> Values, Indices
save = SaveComponent(SaveBtnClicked=values_25.Values)
ppa = _3DPrintedPartAdd(AddBtnClicked=values_26.Values, Selected3DPrintedPart=values_21.Values)
panel_12 = Panel(ppa)
c_script_11 = CSharpScript()  # -> out, A
# ---------- c_script_11: C# ----------
    GH_Document gh_d = owner.OnPingDocument();

    if(gh_d.IsFilePathDefined){
      Print("A path is defined.");
      A = gh_d.FilePath.Substring(0, gh_d.FilePath.LastIndexOf('\\')) + @"\ModelecComponents\ModelecComponents\bin\Sources\increase.png";
    }
    else{
      Print("No path defined.");
    }
# ---------- end c_script_11 ----------
c_script_12 = CSharpScript()  # -> out, A
# ---------- c_script_12: C# ----------
    GH_Document gh_d = owner.OnPingDocument();

    if(gh_d.IsFilePathDefined){
      Print("A path is defined.");
      A = gh_d.FilePath.Substring(0, gh_d.FilePath.LastIndexOf('\\')) + @"\ModelecComponents\ModelecComponents\bin\Sources\decrease.png";
    }
    else{
      Print("No path defined.");
    }
# ---------- end c_script_12 ----------
panel_13 = Panel("""---- Common Parts ---
Ground bus
Power bus
Resistor
Capacitor
Capacitive pad""")
button_17 = CreateButton(ImagePath=c_script_11.A, ButtonStyle=0)
button_18 = CreateButton(ImagePath=c_script_12.A, ButtonStyle=0)
adjustpos_36 = AdjustElementPositioning(
    ElementsToAdjust=button_17,
    Margin="115,-45,0,5",
    AbsolutePositioning=False,
    Width="25",
    Height="25",
    HorizontalAlignment="0")
adjustpos_37 = AdjustElementPositioning(
    ElementsToAdjust=button_18,
    Margin="85,-45,0,5",
    AbsolutePositioning=False,
    Width="25",
    Height="25",
    HorizontalAlignment="0")
label_7 = CreateLabel(LabelText="X:", LabelSize=12, Justification=0)
adjustpos_38 = AdjustElementPositioning(
    ElementsToAdjust=label_7,
    Margin="65,0,0,5",
    AbsolutePositioning=False,
    Width="120",
    Height="35",
    HorizontalAlignment="0")
values_27 = ValueListener(Elements=button_17, SomeProperty=True)  # -> Values, Indices
values_28 = ValueListener(Elements=button_18, SomeProperty=True)  # -> Values, Indices
ppmovexp = _3DPrintedPartMovePosX(AddBtnClicked=values_27.Values)
ppmovexn = _3DPrintedPartMoveNegX(AddBtnClicked=values_28.Values)
pulldown_3 = CreatePulldownMenu(Label="Common part:", ListItems=panel_13, showLabel=True)
adjustpos_39 = AdjustElementPositioning(
    ElementsToAdjust=pulldown_3,
    Margin="5,0,0,5",
    AbsolutePositioning=False,
    Width="305",
    Height="35",
    HorizontalAlignment="0")
c_script_13 = CSharpScript()  # -> out, A; same code as c_script_11
c_script_14 = CSharpScript()  # -> out, A; same code as c_script_12
button_19 = CreateButton(ImagePath=c_script_13.A, ButtonStyle=0)
button_20 = CreateButton(ImagePath=c_script_14.A, ButtonStyle=0)
values_29 = ValueListener(Elements=pulldown_3, SomeProperty=True)  # -> Values, Indices
adjustpos_40 = AdjustElementPositioning(
    ElementsToAdjust=button_19,
    Margin="195,-45,0,5",
    AbsolutePositioning=False,
    Width="25",
    Height="25",
    HorizontalAlignment="0")
adjustpos_41 = AdjustElementPositioning(
    ElementsToAdjust=button_20,
    Margin="165,-45,0,5",
    AbsolutePositioning=False,
    Width="25",
    Height="25",
    HorizontalAlignment="0")
label_8 = CreateLabel(LabelText="Y:", LabelSize=12, Justification=0)
adjustpos_42 = AdjustElementPositioning(
    ElementsToAdjust=label_8,
    Margin="145,-40,0,5",
    AbsolutePositioning=False,
    Width="120",
    Height="35",
    HorizontalAlignment="0")
values_30 = ValueListener(Elements=button_19, SomeProperty=True)  # -> Values, Indices
values_31 = ValueListener(Elements=button_20, SomeProperty=True)  # -> Values, Indices
ppmoveyn = _3DPrintedPartMoveNegY(AddBtnClicked=values_31.Values)
ppmoveyp = _3DPrintedPartMovePosY(AddBtnClicked=values_30.Values)
c_script_15 = CSharpScript()  # -> out, A; same code as c_script_11
c_script_16 = CSharpScript()  # -> out, A; same code as c_script_12
button_21 = CreateButton(ImagePath=c_script_15.A, ButtonStyle=0)
button_22 = CreateButton(ImagePath=c_script_16.A, ButtonStyle=0)

# ---- group: Clear Parts
button_23 = CreateButton(ButtonName="Clear all parts", ButtonStyle=0)
adjustpos_43 = AdjustElementPositioning(
    ElementsToAdjust=button_23,
    Margin="180,-42.5,0,5",
    AbsolutePositioning=False,
    Width="125",
    Height="35",
    HorizontalAlignment="0")
adjustelem_6 = AdjustElementAppearance(ElementsToAdjust=button_23, FontSize=Slider(13, range=0..20))

# ----
adjustpos_44 = AdjustElementPositioning(
    ElementsToAdjust=button_21,
    Margin="275,-45,0,5",
    AbsolutePositioning=False,
    Width="25",
    Height="25",
    HorizontalAlignment="0")
adjustpos_45 = AdjustElementPositioning(
    ElementsToAdjust=button_22,
    Margin="245,-45,0,5",
    AbsolutePositioning=False,
    Width="25",
    Height="25",
    HorizontalAlignment="0")
label_9 = CreateLabel(LabelText="Z:", LabelSize=12, Justification=0)
adjustpos_46 = AdjustElementPositioning(
    ElementsToAdjust=label_9,
    Margin="225,-40,0,5",
    AbsolutePositioning=False,
    Width="120",
    Height="35",
    HorizontalAlignment="0")
values_32 = ValueListener(Elements=button_21, SomeProperty=True)  # -> Values, Indices
values_33 = ValueListener(Elements=button_22, SomeProperty=True)  # -> Values, Indices
ppmovezp = _3DPrintedPartMovePosZ(AddBtnClicked=values_32.Values)
ppmovezn = _3DPrintedPartMoveNegZ(AddBtnClicked=values_33.Values)
size_value = Slider(1, range=1..5)
values_34 = ValueListener(Elements=button_23, SomeProperty=True)  # -> Values, Indices
clearparts = ClearPartsComponent(ClearPartsBtnClicked=values_34.Values)
slider = CreateSlider(Slider=size_value, ShowBounds=False, ShowTicks=False, ShowTooltip=False, ShowValLabel=True, showLabel=True)
adjustpos_47 = AdjustElementPositioning(ElementsToAdjust=slider, Margin="65,0,0,5", AbsolutePositioning=False, Width="100", HorizontalAlignment="0")
values_35 = ValueListener(Elements=slider, SomeProperty=True)  # -> Values, Indices
_3dpparacon = _3DPartParaControlComponent(Level=values_35.Values)

# ---- group: Delete 3D-printed Part
button_24 = CreateButton(ButtonName="Delete", ButtonStyle=0)
adjustpos_48 = AdjustElementPositioning(
    ElementsToAdjust=button_24,
    Margin="245,-45,0,5",
    AbsolutePositioning=False,
    Width="60",
    Height="30",
    HorizontalAlignment="0")
values_36 = ValueListener(Elements=button_24, SomeProperty=True)  # -> Values, Indices

# ----
del3dp = Delete3DPrintedPartComponent(Delete3DPrintedPartBtnClicked=values_36.Values)
update3dplist = Update3DPListComponent(AddListUpdated=ppa, DelListUpdated=del3dp)
panel_14 = Panel(update3dplist)
listbox_2 = CreateListBox(ListItems=panel_14, SelectedIndex="-1", Height="30")
adjustpos_49 = AdjustElementPositioning(
    ElementsToAdjust=listbox_2,
    Margin="5,-505,0,5",
    AbsolutePositioning=False,
    Width="50",
    Height="70",
    HorizontalAlignment="0")
border_2 = CreateBorder(UIElement=listbox_2, BorderThickness="1", BorderColor=RGB(0, 0, 0), CornerRadius=0)
merge = Merge(
    Data1=button_12,
    Data2=label_2,
    Data3=image_2,
    Data4=label_6,
    Data5=image,
    Data6=pulldown,
    Data7=checkbox_3,
    Data8=checkbox_4,
    Data9=checkbox_5,
    Data10=textbox_2,
    Data11=textbox,
    Data12=button_8,
    Data13=button_9,
    Data14=button_10,
    Data15=button_7,
    Data16=button_6,
    Data17=button_5,
    Data18=label_4,
    Data19=button_11,
    Data20=label,
    Data21=label_5,
    Data22=pulldown_2,
    Data23=button_16,
    Data24=label_7,
    Data25=button_18,
    Data26=button_17,
    Data27=label_8,
    Data28=button_20,
    Data29=button_19,
    Data30=label_9,
    Data31=button_22,
    Data32=button_21,
    Data33=slider,
    Data34=listbox_2,
    Data35=border_2,
    Data36=button_24,
    Data40=label_3,
    Data41=checkbox_2,
    Data42=button,
    Data45=button_2,
    Data49=listbox,
    Data50=border,
    Data51=button_3,
    Data52=checkbox,
    Data53=button_13)

# ---- group: Window
launchwin = LaunchWindow(Show=Toggle(True), Name="Modelec Design Tool", Width="330", Height="900", ChildStatus=0, EnableHorizScroll=False)
addelems = AddElements(Window=launchwin, Elements=flatten(merge), DoVLChecking=True)  # -> AddedElements, ElementNames

# ----
adjustpos_50 = AdjustElementPositioning(
    ElementsToAdjust=border_2,
    Margin="5,-505,0,5",
    AbsolutePositioning=False,
    Width="50",
    Height="70",
    HorizontalAlignment="0")
values_37 = ValueListener(Elements=listbox_2, SomeProperty=True)  # -> Values, Indices
sel3dpp = Select3DPrintedPartFromListComponent(PartName=values_37.Values)
panel_15 = Panel(values_37.Values)
